# Grasshopper definition Chapter3.gh (Grasshopper 1.0.7)

# ---- group: Create new Point
c_script = CSharpScript(x=Slider(19.63, range=0..100), y=Slider(51.27, range=0..100), z=Slider(79.63, range=0..100))  # -> out, Point; inputs x: Double, y: Double, z: Double
# ---------- c_script: C# ----------
    //create an instance of a point and initialize to x,y, and z
    Point3d pt = new Point3d (x, y, z);
    
    //assign the point "pt" to output
    Point = pt;
# ---------- end c_script ----------
panel = Panel(c_script.Point)

# ---- group: Dissecting the Point, taking out x, y, and z
point = Point(Point(19.63, 51.27, 79.63))
c_script_2 = CSharpScript(pt=point)  # -> out, A, B, C; inputs pt: Point3d
# ---------- c_script_2: C# ----------
    A = pt.X;
    B = pt.Y;
    C = pt.Z;
# ---------- end c_script_2 ----------
panel_2 = Panel(c_script_2.C)
panel_3 = Panel(c_script_2.B)
panel_4 = Panel(c_script_2.A)

# ---- group: Creating new Point, first making it null then adding the points in there
c_script_3 = CSharpScript(x=Slider(2.1, range=0..10), y=Slider(3.1, range=0..10), z=Slider(4.1, range=0..10))  # -> out, Point; inputs x: Double, y: Double, z: Double
# ---------- c_script_3: C# ----------
    //declare a new point
    Point3d newPoint = new Point3d (Point3d.Unset);

    //set "newPoint" coordinates
    newPoint.X = x;
    newPoint.Y = y;
    newPoint.Z = z;

    //assign the point coordinates to output
    Point = newPoint;
# ---------- end c_script_3 ----------
panel_5 = Panel(c_script_3.Point)

# ---- group: Get the origin points
c_script_4 = CSharpScript()  # -> out, Origin
# ---------- c_script_4: C# ----------
    Origin = Point3d.Origin;
# ---------- end c_script_4 ----------
panel_6 = Panel(c_script_4.Origin)
